# Dynamo graph Read_Python_file.dyn (Dynamo 3.2.1.5366)

file_path = Filename("C:\Users\Bo\Nextcloud\MID\MIDC\Sem_01\C3_Digital_Tools_II\DTM2\Test_File.py")
file_from_path = FileObject(path=file_path)
readText = FileSystem.ReadText(file=file_from_path)
family_types = FamilyTypes("M_Parking Space:4800 x 2400mm - 60 deg")
levels = Levels("L1")
python_script_from_string = PythonStringNode(script=readText, IN[0]=family_types, IN[1]=levels)  # CPython3
watch = Watch(python_script_from_string)
